# Grasshopper definition algorithm.gh (Grasshopper 1.0.7)
# plug-ins: Pufferfish, Anemone, Weaverbird, Chromodoris

start = BooleanToggle(False)
voronoi_count = Slider(100, range=0..1000)
input_brep = Brep(<brep referenced from the Rhino model>)
point_density = Slider(23, range=0..100)

bbox = BoundingBox(Content=input_brep, Plane=PlaneXY(0, 0, 0))  # -> Box, Box_2
debrep = DeconstructBrep(Brep=bbox.Box)  # -> Faces, Edges, Vertices
y轴 = ListItem(List=debrep.Edges, Index=Slider(3, range=0..10), Wrap=True)
x轴 = ListItem(List=debrep.Edges, Index=Slider(2, range=0..10), Wrap=True)
z轴 = ListItem(List=debrep.Edges, Index=Slider(8, range=0..10), Wrap=True)
点 = ListItem(List=debrep.Vertices, Index=Slider(8, range=0..10), Wrap=True)
底平面 = ListItem(List=debrep.Faces, Index=Slider(4, range=0..10), Wrap=True)
len = Length(Curve=y轴)
len_2 = Length(Curve=x轴)
len_3 = Length(Curve=z轴)
num = Number(point_density)
num_2 = Number(point_density)
division = Division(A=len_3, B=num)
点间距 = Integer(division)
division_2 = Division(A=len, B=点间距)
division_3 = Division(A=len_2, B=点间距)
rectangle = Rectangle(Plane=点, XSize=点间距, YSize=点间距, Radius=0)  # -> Rectangle, Length
int = Integer(division_2)
int_2 = Integer(division_3)
arrrec = RectangularArray(Geometry=点, Cell=rectangle.Rectangle, XCount=int_2, YCount=int)  # -> Geometry, Transform
series = Series(Start=0, Step=点间距, Count=num_2)
Z = UnitZ(Factor=series)
contour = Contour(Shape=input_brep, Point=Point(0, 0, 0), Direction=Vector(0, 0, 1), Distance=点间距)  # -> flatten(Contours)
move = Move(Geometry=graft(arrrec.Geometry), Motion=Z)  # -> simplify(Geometry), Transform

num_3 = Number(point_density)
loop_start = LoopStart(N=num_3, T=start, 层数="0", 随机数=Slider(78, range=0..100), D2=点)  # -> port, Counter, Data, Data_2, Data_3
item = ListItem(List=contour, Index=loop_start.Data, Wrap=True)
item_2 = ListItem(List=move.Geometry, Index=loop_start.Data, Wrap=True)
间隔n层 = Evaluate(F="(x-7)/7", x=point_density)
addition = Addition(A=loop_start.Data_2, B="1")
n = Integer(间隔n层)
间隔n层_2 = Evaluate(F="y/x", x=n, y=addition)
随机数 = Integer(间隔n层_2)
rec = Rectangle(底平面)
pt = Point(flatten(item_2))
层数 = Addition(A=loop_start.Data, B="1")
eval = Evaluate(F="3000/x-53", x=point_density)
mesh = Mesh(<mesh referenced from the Rhino model>)
wbframe = WeaverbirdsPictureFrame(MeshPolylines=mesh, Distance=Slider(37, range=0..100), InsetType=0)
preview = CustomPreview(Geometry=wbframe, Material=ColourSwatch(SwatchColor=RGB(255, 255, 255)))

每层生成点随机数 = Slider(50, range=0..100)
pop2d = Populate2D(Region=rec, Count=voronoi_count, Seed=每层生成点随机数)

线连点数 = Slider(5, range=0..10)
num_4 = Number(随机数)
subtraction = Subtraction(A=voronoi_count, B=线连点数)
reduce = RandomReduce(List=pop2d, Reduction=subtraction, Seed=num_4)
线状宽窄程度 = Slider(100, range=0..300)
nurbs = NurbsCurve(Vertices=reduce, Degree=3, Periodic=False)  # -> Curve, Length, Domain
线状型控制线 = Curve(nurbs.Curve)
offcrv = OffsetCurve(Curve=线状型控制线, Distance=线状宽窄程度, Plane=PlaneXY(0, 0, 0), BothSides=False, Kinks=0, CapType=1)
division_4 = Division(A=voronoi_count, B=Slider(5, range=0..10))
boundary = BoundarySurfaces(Edges=offcrv)
popgeo = PopulateGeometry(Geometry=boundary, Count=division_4, Seed=1)

面状大小 = Slider(24, range=0..100)
面状数量 = Slider(5, range=0..10)
subtraction_2 = Subtraction(A=voronoi_count, B=面状数量)
reduce_2 = RandomReduce(List=pop2d, Reduction=subtraction_2, Seed=num_4)  # -> graft(List)
面状控制点 = Point(reduce_2)
cps = ClosestPoints(Point=面状控制点, Cloud=pop2d, Count=面状大小)  # -> flatten(ClosestPoint), CPIndex, Distance

exdiff = SetDifferenceS(SetA=pop2d, SetB=cps.ClosestPoint)
点状控制点 = Point(exdiff)

merge = Merge(Data1=点状控制点, Data2=flatten(面状控制点), Data3=popgeo)  # -> flatten(Result)
vorgroup = VoronoiGroups(Boundary=rec, Generation1=merge)

面状数量_2 = ListLength(List=flatten(面状控制点))
点状数量 = ListLength(List=点状控制点)
addition_2 = Addition(A=面状数量_2, B=点状数量)
subtraction_3 = Subtraction(A=addition_2, B="1")
dom = ConstructDomain(DomainStart=面状数量_2, DomainEnd=subtraction_3)
subset = SubList(List=vorgroup, Domain=dom, Wrap=True)  # -> List, Index

subtraction_4 = Subtraction(A=面状数量_2, B="1")
dom_2 = ConstructDomain(DomainStart="0", DomainEnd=subtraction_4)
subset_2 = SubList(List=vorgroup, Domain=dom_2, Wrap=True)  # -> List, Index

线状数量 = ListLength(List=popgeo)
addition_3 = Addition(A=addition_2, B=线状数量)
subtraction_5 = Subtraction(A=addition_3, B="1")
dom_3 = ConstructDomain(DomainStart=addition_2, DomainEnd=subtraction_5)
subset_3 = SubList(List=vorgroup, Domain=dom_3, Wrap=True)  # -> List, Index

division_5 = Division(A=点状数量, B=Slider(2, range=0..10))
reduce_3 = RandomReduce(List=subset.List, Reduction=division_5, Seed=1)
explode = Explode(Curve=reduce_3, Recursive=True)  # -> flatten(Segments), Vertices
点状密度 = Slider(10, range=0..100)
boundary_2 = BoundarySurfaces(Edges=explode.Segments)  # -> graft(Surfaces)
popgeo_2 = PopulateGeometry(Geometry=boundary_2, Count=点状密度, Seed=1)
ptfitrec = PointFitRectangle(Points=popgeo_2)
vorgroup_2 = VoronoiGroups(Boundary=ptfitrec, Generation1=popgeo_2)
rint = RegionIntersection(CurvesA=vorgroup_2, CurvesB=boundary_2)  # -> flatten(Result)
lng = ListLength(List=rint)
division_6 = Division(A=lng, B=Slider(1.5, range=0..10))
reduce_4 = RandomReduce(List=rint, Reduction=division_6, Seed=1)

fillet = Fillet(Curve=subset_2.List, Radius=Slider(100, range=0..100))
offset = OffsetCurve(Curve=fillet, Distance="-40", Plane=PlaneXY(0, 0, 0), Corners=1)  # -> flatten(Curve)
lng_2 = ListLength(List=offset)
division_7 = Division(A=lng_2, B=Slider(3, range=0..10))
reduce_5 = RandomReduce(List=offset, Reduction=division_7, Seed=1)

fillet_2 = Fillet(Curve=subset_3.List, Radius=Slider(43, range=0..100))
offset_2 = OffsetCurve(Curve=fillet_2, Distance="-15", Plane=PlaneXY(0, 0, 0), Corners=1)  # -> flatten(Curve)
division_8 = Division(A=线状数量, B=Slider(5, range=0..10))
reduce_6 = RandomReduce(List=offset_2, Reduction=division_8, Seed=Slider(100, range=0..100))

merge_2 = Merge(Data1=reduce_4, Data2=reduce_5, Data3=reduce_6)  # -> flatten(Result)
incurve = PointInCurve(Point=pt, Curve=graft(merge_2))  # -> Relationship, Point
cull = CullPattern(List=pt, CullPattern=incurve.Relationship)  # -> flatten(List)
difference = SetDifference(SetA=pt, SetB=cull)
incurve_2 = PointInCurve(Point=difference, Curve=item)  # -> Relationship, Point
cull_2 = CullPattern(List=difference, CullPattern=incurve_2.Relationship)  # -> flatten(List)
sunion = SetUnion(SetA=loop_start.Data_3, SetB=cull_2)
loop_end = LoopEnd(
    port=loop_start.port,
    Exit=False,
    Data=层数,
    Data_2=addition,
    Data_3=sunion,
    TimeOutVal=0,
    pausedState=False,
    state="Constant output")  # -> D0, D1, D2
voxelsample = SampleVoxels(
    Points=loop_end.D2,
    VoxelSize=Slider(35, range=0..1000),
    EffectiveRange=eval,
    DensitySampling=Toggle(True),
    LinearSampling=True)  # -> Box, VoxelData
isosurface = BuildIsoSurface(Box=voxelsample.Box, VoxelData=voxelsample.VoxelData, SampleValue=Slider(0.09, range=0..1))
quicksmooth = QuickSmooth(Mesh=isosurface, Step=0.5, Iterations=Slider(3, range=0..10))
wblaplacehc = WeaverbirdsLaplacianHCSmoothing(MeshCurves=quicksmooth, Level=1, SmoothNakedEdges=1, PartialOriginal=0, Orientation=0, VolumeSavingActivation=1, Thin=1)
wbloop = WeaverbirdsLoopSubdivision(MeshCurves=wblaplacehc, Level=Slider(3, range=0..10), SmoothNakedEdges=1)
wbcatmullclark = WeaverbirdsCatmullClarkSubdivision(MeshCurves=wbloop, Level=1, SmoothNakedEdges=1)
